# Grasshopper definition GHCitySim.ghx (Grasshopper 0.9.76)
# plug-ins: Python Interpreter

ladybug = Ladybug_Ladybug()  # -> Vviiiiiiiiiizzz; plug-in component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
honeybee = Honeybee_Honeybee()  # -> Vviiiiiiiiiizzz; plug-in component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
path = FilePath("C:\Users\peronato\Desktop\CitySimGH\")
number_slider = Slider(2, range=0..10)

# ---- group: Testing area (for Aymeric)
box = CenterBox(Base=PlaneXY(0, 0, 0), X=1, Y=1, Z=1)
brep = Brep(box)
bldgprograms = Honeybee_bldgPrograms({"Office": 0, "Retail": 1, "MidriseApartment": 2, "PrimarySchool": 3, "SecondarySchool": 4, "SmallHotel": 5, "LargeHotel": 6, "Hospital": 7, "Outpatient": 8, "Warehouse": 9, "SuperMarket": 10, "FullServiceRestaurant": 11, "QuickServiceRestaurant": 12}, selected="Office")
createhbsrfs = Honeybee_createHBSrfs(geometry=brep)  # -> readMe, simplify(HBSurface); plug-in component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
createhbzones = Honeybee_createHBZones(name="test", zoneProgram=bldgprograms, HBSurfaces=flatten(createhbsrfs.HBSurface), isConditioned=True)  # -> readMe, HBZone; plug-in component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
setepzonecnstr = Honeybee_SetEPZoneConstruction(
    HBZone=createhbzones.HBZone,
    wallEPConstruction="ASHRAE 189.1-2009 EXTWALL MASS CLIMATEZONE 1",
    roofEPConstruction="ASHRAE 189.1-2009 EXTROOF IEAD CLIMATEZONE 1")  # -> simplify(modifiedHBZone); plug-in component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
citysim_checkmaterials = CitySimCheckMaterials(HBZones=setepzonecnstr)  # -> out; inputs HBZones: list of Brep
# ---------- citysim_checkmaterials: Python ----------
#Extract material properties
#GH-Citysim working component


ghenv.Component.Name = "CitySim-CheckMaterials"
ghenv.Component.NickName = 'CitySim-CheckMaterials'
ghenv.Component.Message = 'WORKING COMPONENT'
ghenv.Component.IconDisplayMode = ghenv.Component.IconDisplayMode.application
ghenv.Component.Category = "Honeybee"
ghenv.Component.SubCategory = "09 | Energy | Energy"
#compatibleHBVersion = VER 0.0.56\nFEB_03_2016
#compatibleLBVersion = VER 0.0.59\nFEB_01_2015
ghenv.Component.AdditionalHelpFromDocStrings = "1"


import Rhino as rc
import scriptcontext as sc
import rhinoscriptsyntax as rs
import os
import System
import Grasshopper.Kernel as gh
import math
import shutil
import collections
import subprocess
import copy

rc.Runtime.HostUtils.DisplayOleAlerts(False)


    
lb_preparation = sc.sticky["ladybug_Preparation"]()
hb_reEvaluateHBZones= sc.sticky["honeybee_reEvaluateHBZones"]
hb_hive = sc.sticky["honeybee_Hive"]()
hb_EPScheduleAUX = sc.sticky["honeybee_EPScheduleAUX"]()
hb_EPPar = sc.sticky["honeybee_EPParameters"]()
    

       
def EPConstructionStr(constructionName):
        constructionData = None
        if constructionName in sc.sticky ["honeybee_constructionLib"].keys():
            constructionData = sc.sticky ["honeybee_constructionLib"][constructionName]
        
        if constructionData!=None:
            materials = []
            numberOfLayers = len(constructionData.keys())
            constructionStr = constructionData[0] + ",\n"
            # add the name
            constructionStr =  constructionStr + "  " + constructionName + ",   !- name\n"
            
            for layer in range(1, numberOfLayers):
                if layer < numberOfLayers-1:
                    constructionStr =  constructionStr + "  " + constructionData[layer][0] + ",   !- " +  constructionData[layer][1] + "\n"
                else:
                    constructionStr =  constructionStr + "  " + constructionData[layer][0] + ";   !- " +  constructionData[layer][1] + "\n\n"
                materials.append(constructionData[layer][0])
                
            return materials
        else:
            warning = "Failed to find " + constructionName + " in library."
            print warning
            ghenv.Component.AddRuntimeMessage(gh.GH_RuntimeMessageLevel.Warning, warning)
            return None, None
            
 
def getMaterialProperties(matName):
    if not sc.sticky["honeybee_release"]:
        print "You should first let Honeybee to fly..."
        w = gh.GH_RuntimeMessageLevel.Warning
        ghenv.Component.AddRuntimeMessage(w, "You should first let Honeybee to fly...")
        return -1

    try:
        if not sc.sticky['honeybee_release'].isCompatible(ghenv.Component): return -1
        if sc.sticky['honeybee_release'].isInputMissing(ghenv.Component): return -1
    except:
        warning = "You need a newer version of Honeybee to use this compoent." + \
        " Use updateHoneybee component to update userObjects.\n" + \
        "If you have already updated userObjects drag Honeybee_Honeybee component " + \
        "into canvas and try again."
        w = gh.GH_RuntimeMessageLevel.Warning
        ghenv.Component.AddRuntimeMessage(w, warning)
        return -1
    
    # get the constuction
    try:
        hb_EPMaterialAUX = sc.sticky["honeybee_EPMaterialAUX"]()
    except:
        msg = "Failed to load EP constructions!"
        ghenv.Component.AddRuntimeMessage(w, msg)
        return -1
    
    if sc.sticky.has_key("honeybee_materialLib"):
        result = hb_EPMaterialAUX.decomposeMaterial(matName.upper(), ghenv.Component)
        if result == -1:
            warning = "Failed to find " + matName + " in the Honeybee material library."
            print warning
            ghenv.Component.AddRuntimeMessage(gh.GH_RuntimeMessageLevel.Warning, warning)
        return result
        

    
# call the objects from the lib
thermalZonesPyClasses = hb_hive.callFromHoneybeeHive(_HBZones)



for zone in thermalZonesPyClasses:

        schedules = zone.getCurrentSchedules(True)
        loads = zone.getCurrentLoads(True)
        
                
        for srf in zone.surfaces:

            if srf.EPConstruction != None:
                srf.construction = srf.EPConstruction

                print "Construction:"
                print "\n"
                print srf.construction
                materials = EPConstructionStr(srf.construction)
                for m in materials:
                    print "Material: ", m
                    print "Material properties : ", getMaterialProperties(m)
                    print "\n"
                print "\n"
# ---------- end citysim_checkmaterials ----------
panel = Panel(citysim_checkmaterials)

# ----
epw_path = FilePath("C:\Users\peronato\Documents\WeatherFiles\Neuchatel-hour.epw")
path_2 = FilePath(path)
brep_2 = Brep([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])
number_slider_2 = Slider(80, range=0..100)
custom_mesh_settings = SettingsCustom(
    StitchSeams=True,
    SimplePlanes=False,
    Refine=True,
    MinCount=0,
    MaxCount=0,
    AspectRatio=20,
    MaxDistance=0,
    MaxAngle=20,
    MinEdge=number_slider,
    MaxEdge=number_slider)
epw_to_clim = Ladybug_EpwToClim(epwFile=epw_path, path=path_2, Run=Toggle(False))  # -> out, climatefile; plug-in component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
epnomassmat = Honeybee_EnergyPlusNoMassOpaqueMaterial(name="facade", R_Value=Slider(1, range=0..1), solAbsp=Slider(0.2, range=0..1))  # -> EPMaterial; plug-in component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
separatebynormal = Honeybee_SeparateByNormal(geometry=brep_2, maxUpDecAngle=number_slider_2, maxDownDecAngle=number_slider_2)  # -> simplify(lookingUp), simplify(lookingDown), simplify(lookingSide); plug-in component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
epconstruction = Honeybee_EnergyPlusConstruction(name="facade", layer_1=epnomassmat)  # -> EPConstruction; plug-in component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
mesh = MeshBrep(Brep=brep_2, Settings=custom_mesh_settings)
exportladybug = Ladybug_ExportLadybug(components="*", targetFolder="C:\Users\peronato\Documents\GitHub\GHCitySim", export=Toggle(False))  # -> readMe; plug-in component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
faceb = FaceBoundaries(Mesh=mesh)  # -> simplify(Boundaries)
createhbsrfs_2 = Honeybee_createHBSrfs(geometry=separatebynormal.lookingUp, srfType=Slider(1, range=0..1), EPConstruction=epconstruction)  # -> readMe, simplify(HBSurface); plug-in component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
createhbsrfs_3 = Honeybee_createHBSrfs(geometry=separatebynormal.lookingDown, srfType=Slider(2.5, range=0..10), EPConstruction=epconstruction)  # -> readMe, simplify(HBSurface); plug-in component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
createhbsrfs_4 = Honeybee_createHBSrfs(geometry=separatebynormal.lookingSide, srfType=Slider(0, range=0..100), EPConstruction=epconstruction)  # -> readMe, simplify(HBSurface); plug-in component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
srf = Surface(faceb)
createhbsrfs_5 = Honeybee_createHBSrfs(geometry=srf)  # -> readMe, simplify(HBSurface); plug-in component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
mass2zone = Honeybee_Masses2Zones(zoneMasses=flatten(brep_2), isConditioned=True, maxRoofAngle=30, createHBZones=Toggle(True))  # -> readMe, HBZones; plug-in component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
path_mapper = PathMapper(createhbsrfs_3.HBSurface, source=["{A}", "{A;B}"], target=["{A}", "{A}"])
path_mapper_2 = PathMapper(createhbsrfs_2.HBSurface, source=["{A}", "{A;B}"], target=["{A}", "{A}"])
path_mapper_3 = PathMapper(createhbsrfs_4.HBSurface, source=["{A}", "{A;B}"], target=["{A}", "{A}"])
tstat = TreeStatistics(Tree=srf)  # -> Paths, Length, Count
epopaquemat = Honeybee_EnergyPlusOpaqueMaterial()  # -> EPMaterial; plug-in component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
createhbzones_2 = Honeybee_createHBZones(name=tstat.Paths, HBSurfaces=flatten(createhbsrfs_5.HBSurface), isConditioned=True)  # -> readMe, simplify(HBZone); plug-in component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
createhbzones_3 = Honeybee_createHBZones(name=tstat.Paths, HBSurfaces=flatten([path_mapper_2, path_mapper, path_mapper_3]), isConditioned=True)  # -> readMe, simplify(HBZone); plug-in component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
zones_with_detailed_mesh = Data(createhbzones_2.HBZone)
simplified_zones = Data(mass2zone.HBZones)
citysim_checkmaterials_2 = CitySimCheckMaterials(HBZones=createhbzones_3.HBZone)  # -> out; inputs HBZones: list of Brep
# ---------- citysim_checkmaterials_2: Python ----------
#Extract material properties
#GH-Citysim working component


ghenv.Component.Name = "CitySim-CheckMaterials"
ghenv.Component.NickName = 'CitySim-CheckMaterials'
ghenv.Component.Message = 'WORKING COMPONENT'
ghenv.Component.IconDisplayMode = ghenv.Component.IconDisplayMode.application
ghenv.Component.Category = "Honeybee"
ghenv.Component.SubCategory = "09 | Energy | Energy"
#compatibleHBVersion = VER 0.0.56\nFEB_03_2016
#compatibleLBVersion = VER 0.0.59\nFEB_01_2015
ghenv.Component.AdditionalHelpFromDocStrings = "1"


import Rhino as rc
import scriptcontext as sc
import rhinoscriptsyntax as rs
import os
import System
import Grasshopper.Kernel as gh
import math
import shutil
import collections
import subprocess
import copy

rc.Runtime.HostUtils.DisplayOleAlerts(False)


    
lb_preparation = sc.sticky["ladybug_Preparation"]()
hb_reEvaluateHBZones= sc.sticky["honeybee_reEvaluateHBZones"]
hb_hive = sc.sticky["honeybee_Hive"]()
hb_EPScheduleAUX = sc.sticky["honeybee_EPScheduleAUX"]()
hb_EPPar = sc.sticky["honeybee_EPParameters"]()
    

       
def EPConstructionStr(constructionName):
        constructionData = None
        if constructionName in sc.sticky ["honeybee_constructionLib"].keys():
            constructionData = sc.sticky ["honeybee_constructionLib"][constructionName]
        
        if constructionData!=None:
            materials = []
            numberOfLayers = len(constructionData.keys())
            constructionStr = constructionData[0] + ",\n"
            # add the name
            constructionStr =  constructionStr + "  " + constructionName + ",   !- name\n"
            
            for layer in range(1, numberOfLayers):
                if layer < numberOfLayers-1:
                    constructionStr =  constructionStr + "  " + constructionData[layer][0] + ",   !- " +  constructionData[layer][1] + "\n"
                else:
                    constructionStr =  constructionStr + "  " + constructionData[layer][0] + ";   !- " +  constructionData[layer][1] + "\n\n"
                materials.append(constructionData[layer][0])
                
            return materials
        else:
            warning = "Failed to find " + constructionName + " in library."
            print warning
            ghenv.Component.AddRuntimeMessage(gh.GH_RuntimeMessageLevel.Warning, warning)
            return None, None
            
 
def getMaterialProperties(matName):
    if not sc.sticky["honeybee_release"]:
        print "You should first let Honeybee to fly..."
        w = gh.GH_RuntimeMessageLevel.Warning
        ghenv.Component.AddRuntimeMessage(w, "You should first let Honeybee to fly...")
        return -1

    try:
        if not sc.sticky['honeybee_release'].isCompatible(ghenv.Component): return -1
        if sc.sticky['honeybee_release'].isInputMissing(ghenv.Component): return -1
    except:
        warning = "You need a newer version of Honeybee to use this compoent." + \
        " Use updateHoneybee component to update userObjects.\n" + \
        "If you have already updated userObjects drag Honeybee_Honeybee component " + \
        "into canvas and try again."
        w = gh.GH_RuntimeMessageLevel.Warning
        ghenv.Component.AddRuntimeMessage(w, warning)
        return -1
    
    # get the constuction
    try:
        hb_EPMaterialAUX = sc.sticky["honeybee_EPMaterialAUX"]()
    except:
        msg = "Failed to load EP constructions!"
        ghenv.Component.AddRuntimeMessage(w, msg)
        return -1
    
    if sc.sticky.has_key("honeybee_materialLib"):
        result = hb_EPMaterialAUX.decomposeMaterial(matName.upper(), ghenv.Component)
        if result == -1:
            warning = "Failed to find " + matName + " in the Honeybee material library."
            print warning
            ghenv.Component.AddRuntimeMessage(gh.GH_RuntimeMessageLevel.Warning, warning)
        return result
        

    
# call the objects from the lib
thermalZonesPyClasses = hb_hive.callFromHoneybeeHive(_HBZones)



for zone in thermalZonesPyClasses:

        schedules = zone.getCurrentSchedules(True)
        loads = zone.getCurrentLoads(True)
        
                
        for srf in zone.surfaces:
            print srf.type
            if srf.EPConstruction != None:
                srf.construction = srf.EPConstruction

                print "Construction:"
                print "\n"
                print srf.construction
                materials = EPConstructionStr(srf.construction)
                for m in materials:
                    print "Material: ", m
                    print "Material properties : ", getMaterialProperties(m)
                    print "\n"
                print "\n"
# ---------- end citysim_checkmaterials_2 ----------
hbzones = Data(createhbzones_3.HBZone)
path_3 = FilePath(path)
path_4 = FilePath(path)
citysim_loadresults = Honeybee_CitySimLoadResults(path=path_3, name="test", HBZones=flatten(hbzones), Run=Toggle(False))  # -> SW, Surfaces; plug-in component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
citysim_runsimulation = Honeybee_CitySimRunSimulation(
    HBZones=flatten(hbzones),
    path=path_4,
    name="test",
    climatefile=epw_to_clim.climatefile,
    Solver="C:\CitySim.exe",
    Write=Toggle(False),
    Run=Toggle(False))  # plug-in component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
explode = Explode(Curve=citysim_loadresults.Surfaces, Recursive=True)  # -> Segments, simplify(Vertices)
srf_2 = Surface(citysim_loadresults.Surfaces)
lng = ListLength(List=explode.Vertices)
equals = Equality(FirstNumber=lng, SecondNumber="5")  # -> simplify(Equality), Inequality
equals_2 = Equality(FirstNumber=lng, SecondNumber="4")  # -> simplify(Equality), Inequality
dup = DuplicateData(Data=equals.Equality, Number=lng, Order=True)  # -> simplify(Data)
ma = MassAddition(Input=citysim_loadresults.SW)  # -> Result, PartialResults
dup_2 = DuplicateData(Data=equals_2.Equality, Number=lng, Order=True)  # -> simplify(Data)
dispatch = Dispatch(List=explode.Vertices, DispatchPattern=dup)  # -> ListA, ListB
dispatch_2 = Dispatch(List=explode.Vertices, DispatchPattern=dup_2)  # -> ListA, ListB
division = Division(A=ma.Result, B=1000)
clean = CleanTree(RemoveNulls=True, RemoveInvalid=True, RemoveEmpty=True, Tree=dispatch.ListA)
clean_2 = CleanTree(RemoveNulls=True, RemoveInvalid=True, RemoveEmpty=True, Tree=dispatch_2.ListA)
bnd = Bounds(Numbers=flatten(division))
quad = MeshQuad(CornerA=0, CornerB=1, CornerC=2, CornerD=3)
triangle = MeshTriangle(CornerA=0, CornerB=1, CornerC=2)
dedomain = DeconstructDomain(Domain=bnd)  # -> Start, End
conmesh = ConstructMesh(Vertices=clean, Faces=quad)
conmesh_2 = ConstructMesh(Vertices=clean_2, Faces=triangle)
gradient = Gradient(
    LowerLimit=Slider(0, range=0..100),
    UpperLimit=dedomain.End,
    Parameter=division,
    stops=[0: RGB(0, 0, 255), 0.499: RGB(255, 255, 0), 1: RGB(255, 0, 0)])
mjoin = MeshJoin(Meshes=[conmesh_2, conmesh])
preview = CustomPreview(Geometry=srf_2, Shader=gradient)
mcol = MeshColours(Mesh=mjoin, Colours=gradient)
